# Dynamo graph Импорт в ексель.dyn (Dynamo 2.3.0.5885)

# group: add suffix
code_block = CodeBlock { "_from_revit_"; }
file_name = Python(IN[0]=code_block)
# ---------- file_name.python (30 lines) ----------
import clr
clr.AddReference('ProtoGeometry')
clr.AddReference("RevitNodes")
from Autodesk.DesignScript.Geometry import *
clr.AddReference('RevitAPI')
from Autodesk.Revit.DB import *
clr.AddReference("DSCoreNodes")
clr.AddReference("RevitServices")
import RevitServices
from RevitServices.Persistence import DocumentManager

import os
from datetime import datetime

def create_excele_file_in_cdirectory(add_file_name):
	add_file_name = str(add_file_name)
	cur_date=datetime.now().strftime("%Y_%m_%d")
	doc = DocumentManager.Instance.CurrentDBDocument
	uiapp = DocumentManager.Instance.CurrentUIApplication
	app = uiapp.Application
	uidoc = DocumentManager.Instance.CurrentUIApplication.ActiveUIDocument
	doc_path = doc.PathName
	doc_titel_name = doc.Title
	dir_path = os.path.dirname(doc_path)
	excel_file_name = doc_titel_name+add_file_name+cur_date+ ".xlsx"
	full_path = os.path.join(dir_path,excel_file_name)
	return full_path
file_name =IN[0]
full_path = create_excele_file_in_cdirectory(file_name)
OUT = full_path
# ----------------------------------------
watch = Watch(file_name)

# group: read parameters from excel
user_custom_parameters_exel_file = Filename(".\Параметры в проект_файл для общих параметров.xlsx")  # "user custom parameters (exel_file "to revit")"; graph input
# note: Скрипт по экспорту параметров из модели в ексель.
# пользовательские параметры получаем из файла ексель, общие параметры (площадь. объем, итд) получаем из списка параметров. Ревит id получаем автоматически
file_from_path = FileObject(path=user_custom_parameters_exel_file)
string = StringInput("param_dict")
get_param_names = Python(IN[0]=file_from_path, IN[1]=string)
# ---------- get_param_names.python (28 lines) ----------
# -*- coding: utf-8 -*- 
import sys
import os
import clr
clr.AddReference('ProtoGeometry')
clr.AddReference("RevitNodes")
clr.AddReference("DSCoreNodes")
clr.AddReference("DSOffice")
from Autodesk.DesignScript.Geometry import *
clr.AddReference('RevitAPI')
from Autodesk.Revit.DB import *
from DSCore.List import Transpose,AddItemToFront,DropItems,SortByKey
from DSOffice.Data import ImportExcel
import os

sys.path.append(r'C:\Program Files (x86)\IronPython 2.7\Lib')

path_excel =IN[0]
shet_name =IN[1]


#забираем из ексель таблицу.
import_excel = ImportExcel(path_excel,shet_name)
#отбрасываем названия столбцов
drop_list_excel = DropItems(import_excel,1)
transpose_list = Transpose(drop_list_excel)

OUT = transpose_list
# ----------------------------------------

# group: read from spaces
categories = Categories("OST_MEPSpaces")
all_elements_of_category = ElementsOfCategory(Category=categories)
code_block_2 = CodeBlock(name=get_param_names)
# ---------- code_block_2.designscript (4 lines) ----------
//parameters_names;
name[0];
//columns_names;
name[1];
# ----------------------------------------
get_param_value = Python(IN[0]=all_elements_of_category, IN[1]=code_block_2.out0, IN[2]=code_block_2.out1)
# ---------- get_param_value.python (36 lines) ----------
import clr
clr.AddReference('ProtoGeometry')
clr.AddReference("RevitNodes")
from Autodesk.DesignScript.Geometry import *
clr.AddReference('RevitAPI')
from Autodesk.Revit.DB import *
clr.AddReference("DSCoreNodes")
from DSCore.List import Transpose,AddItemToFront

def GPVBN(space,name):
	P_Valu = [i.GetParameterValueByName(name) for i in space]
	return P_Valu

space = IN[0]
parameter_names = IN[1]
list_heads = IN[2]

space_Id = [i.Id for i in space]


list_app =[]
"""
for i in list_contest:	
	temp = GPVBN(space,i)
	
	list_app.append(temp)
"""
list_app = [GPVBN(space,i) for i in parameter_names]

list_app.insert(0,space_Id) 	
list_heads.insert(0,"S_ID")
transpose_list = Transpose(list_app)
front_list = AddItemToFront(list_heads,transpose_list)


OUT = front_list
# ----------------------------------------

# group: export excel.current path
code_block_3 = CodeBlock { "Revit_spaces"; }
code_block_4 = CodeBlock { 0; }
exportExcel = Data.ExportExcel(filePath=file_name, sheetName=code_block_3, startRow=code_block_4, startCol=code_block_4, data=get_param_value)
