# Dynamo graph InsertTerminalsByJson.dyn (Dynamo 2.3.0.5885)

# group: script path
script = Filename(".\app.py")  # graph input
file_from_path = FileObject(path=script)
readText = FileSystem.ReadText(file=file_from_path)

# group: choose json
json = Filename("..\json_data_add_test.json")  # graph input
file_from_path_2 = FileObject(path=json)

python_script_from_string = PythonStringNode(script=readText, IN[0]=file_from_path, IN[1]=file_from_path_2)
